# Grasshopper definition ConnectToServer_Paul2.gh (Grasshopper 1.0.5)

c_script = CSharpScript(
    x=Button(),
    Reference=["C:\Users\epoulsen\Documents\GitHub\GrasshopperLive\src\csharp\GrasshopperLive.Core\bin\Debug\GrasshopperLive.Core.dll", "C:\Program Files\Rhino 6\Plug-ins\Grasshopper\Components\CurveComponents.gha"])  # -> out, A; inputs x: Boolean
# ---------- c_script: C# ----------
    if(x)
    {
      if(!_alreadySubscribedFlag)
      {
        GrasshopperDocument.ObjectsAdded += ObjectsAddedEvent;
        //GrasshopperDocument.OnObjectsAdded(GrasshopperDocument.Objects);
        _alreadySubscribedFlag = true;
      }

      GrasshopperLive.GrasshopperLive ghLive;
      ghLive = new GrasshopperLive.GrasshopperLive();
      ghLive.DataReceived += GhLive_DataReceived;
      ghLive.Connect();
      _id = ghLive.SocketId;
      _log.Add("senderId: " + _id);
      //_ghLive = ghLive;
    }
    A = _log;
# ---------- c_script: C# additional code ----------
  List<string> _log = new List<string>();
  string _id;
  bool _alreadySubscribedFlag;
  //GrasshopperLive.GrasshopperLive _ghLive;

  void ObjectsAddedEvent (object sender, EventArgs e){

    //_log.Add(" object added event");
    //Grasshopper.Kernel.GH_Document doc = (Grasshopper.Kernel.GH_Document) sender;
    //Grasshopper.Kernel.GH_DocObjectEventArgs args = (Grasshopper.Kernel.GH_DocObjectEventArgs) e;

    try{
      //var obj = args.Objects[args.ObjectCount - 1];
      //Grasshopper.Kernel.GH_Component comp = (Grasshopper.Kernel.GH_Component) obj;

      //IGH_Component comp2 = (IGH_Component) obj;

    } catch (Exception ex){
      //Print(ex.Message);
    }



    //GrasshopperDocument.ExpireSolution();
  }

  private void GhLive_DataReceived(object sender, GhLiveEventArgs e)
  {
    
    _log.Add("sender:  " + e.TheObject.Sender + " " + e.TheObject.Message);
    if(e.TheObject.Sender == _id){
      _log.Add("not creating a component!");
      return;
    }


    //System.Windows.Forms.MessageBox.Show(e.TheObject.Message);

    //_messageLog.Add(e.TheObject.Message);
    //Grasshopper.Instances.DocumentEditor. //BeginInvoke(new Action(() => { GH_JoinSession.Application.ExpireSolution(true); }));
    //GH_JoinSession.Application.ExpireSolution(true);
    _log.Add(e.TheObject.Message);
    //_log.Add("WOW!");


    //------------------

    CurveComponents.Component_CircleCNR cs = new CurveComponents.Component_CircleCNR();

    cs.CreateAttributes();
    cs.Attributes.Pivot = new System.Drawing.PointF(100, 100);

    GH_Document doc = Grasshopper.Instances.ActiveCanvas.Document;
    IList<IGH_DocumentObject> documentObjects = doc.Objects;

    bool IsAdded = doc.AddObject(cs, false, 1);

    //------------------

    //Component.ExpireSolution(true);
    //Component.ExpireSolution(true);
    //GrasshopperDocument.NewSolution(true);

    //Grasshopper.GUI.Canvas.GH_Canvas canvas = Grasshopper.Instances.ActiveCanvas;

    Grasshopper.Instances.DocumentEditor.BeginInvoke(new Action(() => { Component.ExpireSolution(true); }));



  }
# ---------- end c_script ----------

# ---- group: Document Events
c_script_2 = CSharpScript()  # -> out, A, B, C, D, E
# ---------- c_script_2: C# ----------
    Print("Document Name: " + GrasshopperDocument.DisplayName);

    // string name = "Charlie";
    // GrasshopperDocument.ObjectsAdded += GrasshopperDocument.ObjectsAddedEventHandler;

    // subscribe to OnObjects Added
    GrasshopperDocument.ObjectsAdded += ObjectsAddedEvent;

    GrasshopperDocument.OnObjectsAdded(GrasshopperDocument.Objects);

    // unsubscribe to OnObjects Added
    GrasshopperDocument.ObjectsAdded -= ObjectsAddedEvent;

    //
    GrasshopperDocument.ModifiedChanged += ModifiedEvent;
    GrasshopperDocument.OnModifiedChanged();
    GrasshopperDocument.ModifiedChanged -= ModifiedEvent;

    //GrasshopperDocument.ObjectsAdded();
# ---------- c_script_2: C# additional code ----------
  void ObjectsAddedEvent (object sender, EventArgs e){
    Print("Sender: {0} | EventArgs: {1}", sender.GetType().ToString(), e.GetType().ToString());

    Grasshopper.Kernel.GH_Document doc = (Grasshopper.Kernel.GH_Document) sender;
    Grasshopper.Kernel.GH_DocObjectEventArgs args = (Grasshopper.Kernel.GH_DocObjectEventArgs) e;

    Print("Number of objects on canvas: " + args.ObjectCount.ToString());
    Print("Object type: " + args.Objects[args.ObjectCount - 1].GetType().ToString());
    Print(args.Objects[args.ObjectCount - 1].Name);

    try{
      var obj = args.Objects[args.ObjectCount - 1];
      Grasshopper.Kernel.GH_Component comp = (Grasshopper.Kernel.GH_Component) obj;
      //Print("Location: {0} | {1}", comp.Attributes..Attributes.Pivot.X.ToString(), comp2.Attributes.Pivot.Y.ToString());

      IGH_Component comp2 = (IGH_Component) obj;
      Print("Location2: {0} | {1}", comp2.Attributes.Pivot.X.ToString(), comp2.Attributes.Pivot.Y.ToString());
      Print("Component ID: " + comp2.ComponentGuid.ToString());
    } catch (Exception ex){
      Print(ex.Message);
    }

    GrasshopperDocument.ExpireSolution();
  }


  void ModifiedEvent(object sender, EventArgs e){
    Print("Sender: {0} | EventArgs: {1}", sender.GetType().ToString(), e.GetType().ToString());

    Grasshopper.Kernel.GH_Document doc = (Grasshopper.Kernel.GH_Document) sender;
    Grasshopper.Kernel.GH_DocModifiedEventArgs args = (Grasshopper.Kernel.GH_DocModifiedEventArgs) e;

    Print("Document Modified: " + args.Modified);
  }
# ---------- end c_script_2 ----------
panel = Panel(c_script_2.out)
panel_2 = Panel(c_script_2.A)

# ----
panel_3 = Panel(c_script.A)
